# Grasshopper definition illustrations_of_formfinding_simple_setup.gh (Grasshopper 1.0.7)
# plug-ins: Human, Kangaroo2 Components

# ---- group: Objectives
minimum_edge_length = GhPythonScript(minimum_length=Slider(12.285, range=0..500), weight=Slider(942.696, range=0..1000))  # -> obj
# ---------- minimum_edge_length: Python ----------
__author__ = "Adam"
__version__ = "2022.12.05"

import rhinoscriptsyntax as rs

import json

objective = "minimum_edge_length"

format = {"objective":objective,"weight":weight,"min_length":minimum_length}

obj = json.dumps(format, indent=4)
# ---------- end minimum_edge_length ----------
match_plan_location = GhPythonScript(weight=Slider(590.914, range=0..1000))  # -> obj
# ---------- match_plan_location: Python ----------
__author__ = "Adam"
__version__ = "2022.12.03"

import rhinoscriptsyntax as rs
import json

objective = "match_plan_location"

obj = json.dumps({"objective":objective,"weight":weight}, indent =4)
# ---------- end match_plan_location ----------
σ_f_l = GhPythonScript(weight=Slider(147.179, range=0..1000))  # -> obj
# ---------- σ_f_l: Python ----------
__author__ = "Adam"
__version__ = "2022.12.05"

import rhinoscriptsyntax as rs

import json

objective = "structural_performance"
format = {"objective":objective, "weight":weight}

obj = json.dumps(format, indent=4)
# ---------- end σ_f_l ----------
match_target_shape_euclidian_dist = GhPythonScript(weight=Slider(100, range=0..100))  # -> obj
# ---------- match_target_shape_euclidian_dist: Python ----------
__author__ = "Adam"
__version__ = "2022.12.03"

import rhinoscriptsyntax as rs
import json

objective = "match_target_shape_euclidian_dist"

obj = json.dumps({"objective":objective,"weight":weight}, indent =4)
# ---------- end match_target_shape_euclidian_dist ----------
maximum_edge_length = GhPythonScript(maximum_length=0, weight=0)  # -> obj
# ---------- maximum_edge_length: Python ----------
__author__ = "Adam"
__version__ = "2022.12.05"

import rhinoscriptsyntax as rs

import json

objective = "maximum_edge_length"

format = {"objective":objective,"weight":weight,"max_length":maximum_length}

obj = json.dumps(format, indent=4)
# ---------- end maximum_edge_length ----------
match_target__matrix_norm = GhPythonScript(weight=Slider(50, range=0..1000))  # -> obj
# ---------- match_target__matrix_norm: Python ----------
__author__ = "Adam"
__version__ = "2022.12.03"

import rhinoscriptsyntax as rs
import json

objective = "match_target_shape_matrix_norm"

obj = json.dumps({"objective":objective,"weight":weight}, indent =4)
# ---------- end match_target__matrix_norm ----------
min_sum_lengths = GhPythonScript(weight=1)  # -> obj
# ---------- min_sum_lengths: Python ----------
__author__ = "Adam"
__version__ = "2022.12.03"

import rhinoscriptsyntax as rs
import json

objective = "min_sum_lengths"

obj = json.dumps({"objective":objective,"weight":weight}, indent =4)
# ---------- end min_sum_lengths ----------
min_force = GhPythonScript()  # -> obj
# ---------- min_force: Python ----------
__author__ = "Adam"
__version__ = "2022.12.05"

import rhinoscriptsyntax as rs

import json

objective = "min_force"
format = {"objective":objective, "weight":weight}

obj = json.dumps(format, indent=4)
# ---------- end min_force ----------
min_variation = GhPythonScript()  # -> obj
# ---------- min_variation: Python ----------
__author__ = "Adam"
__version__ = "2022.12.05"

import rhinoscriptsyntax as rs

import json

objective = "min_variation"
format = {"objective":objective, "weight":weight}

obj = json.dumps(format, indent=4)
# ---------- end min_variation ----------

# ---- group: Simple Network Generation
number_slider = Slider(20, range=1..50)
mplane = MeshPlane(
    Boundary={Plane=PlaneXY(0, 0, 0), Size=Domain2(u=-10..10, v=-10..10)},
    WidthCount=number_slider,
    HeightCount=number_slider)  # -> Mesh, Area
mc = MeshCorners(Mesh=mplane.Mesh, Angle=2.35619449)
medges = MeshEdges(Mesh=mplane.Mesh)  # -> NakedEdges, InteriorEdges, NonManifoldEdges
geo = Geometry([medges.InteriorEdges, medges.NakedEdges])
preview = CustomPreview(Geometry=geo, Material=ColourSwatch(SwatchColor=RGB(153, 153, 153)))

# ---- group: Optimizer Settings
update_frequency = Slider(2, range=1..100)
dfdm_settings = GhPythonScript(
    q_lower_bounds=Slider(1, range=-10..10),
    q_upper_bounds=Slider(200, range=0..2000),
    absolute_tolerance=Slider(0.1, range=0..0.1),
    relative_tolerance=1e-10,
    max_iterations=Slider(5000, range=1..100000),
    objectives=match_target_shape_euclidian_dist,
    show_iterations=Toggle(True),
    update_frequency=update_frequency)  # -> settings; inputs objectives: list, show_iterations: Boolean
# ---------- dfdm_settings: Python ----------
__author__ = "adam"
__version__ = "2022.11.29"

import rhinoscriptsyntax as rs
import json

objs = []
for objective in objectives:
    obj = json.loads(objective)
    objs.append(obj)

format = {"lb":q_lower_bounds,"ub":q_upper_bounds,"abstol":absolute_tolerance,"reltol":relative_tolerance, "maxiters":max_iterations,"objectives":objs,"show":show_iterations,"freq":update_frequency} 

settings = json.dumps(format,indent=4)
# ---------- end dfdm_settings ----------

# ----
panel = Panel(dfdm_settings)

# ---- group: Format Network
number_slider_2 = Slider(0, range=0..2000)
anchors = Geometry(flatten(mc))
clean = CleanTree(RemoveNulls=True, RemoveInvalid=True, RemoveEmpty=False, Tree=anchors)
neg = Negative(Value=number_slider_2)
close_server = Button()
vec = VectorXYZ(XComponent=0, YComponent=0, ZComponent=number_slider_2)  # -> Vector, Length
construct_network = GhPythonScript(
    curves=geo,
    anchors=anchors,
    loads=vec.Vector,
    initial_q=Slider(3, range=1..20),
    settings=dfdm_settings,
    close=close_server,
    point_tol="5")  # -> network, simplify(nodes), simplify(edge_names), simplify(edge_end_IDs); inputs curves: list of Curve, curve_IDs: list, anchors: list of Point3d, loads: list of Vector3d, initial_q: list, point_tol: Int32
# ---------- construct_network: Python ----------
__author__ = "adam"
__version__ = "2022.11.26"
        
import rhinoscriptsyntax as rs
import ghpythonlib.treehelpers as th
import json
import Grasshopper.Kernel as gh
import itertools
import Rhino
import time

time.sleep(0.01)

#print(settings)

e = gh.GH_RuntimeMessageLevel.Error
w = gh.GH_RuntimeMessageLevel.Warning

def format_nodes_edges(curves,curve_IDs):
    nodes = []
    nodes_Point3d = []
    edges = {}
    fixed = []

    for i, crv in enumerate(curves):
        start_pt = rs.CurveStartPoint(crv)
        sx = round(start_pt.X,point_tol)
        sy = round(start_pt.Y,point_tol)
        sz = round(start_pt.Z,point_tol)
        start = [sx, sy, sz]
        end_pt = rs.CurveEndPoint(crv)
        ex = round(end_pt.X,point_tol)
        ey = round(end_pt.Y,point_tol)
        ez = round(end_pt.Z,point_tol)
        end = [ex, ey, ez]
        edge = []
        if start in nodes:
            #add +1 indexing for julia 1 based indexing
            edge.append(nodes.index(start)+1)
        else:
            nodes.append(start)
            nodes_Point3d.Add(start_pt)
            edge.append(nodes.index(start)+1)
        if end in nodes:
            edge.append(nodes.index(end)+1)
        else:
            nodes.append(end)
            nodes_Point3d.Add(end_pt)
            edge.append(nodes.index(end)+1)
        if len(curve_IDs) == 0:
            edges[str(i+1)] = edge
        elif len(curve_IDs) != len(curves):
            edges[str(i+1)] = edge
            ghenv.Component.AddRuntimeMessage(w,'Curve ID count does not match number of curves') 
        else:
            edges[str(curve_IDs[i])] = edge
    for point in anchors:
        closestPtIndex = Rhino.Collections.Point3dList.ClosestIndexInList(nodes_Point3d, rs.coerce3dpoint(point))
        fixed.append(closestPtIndex+1)
    free = list(set(range(1,len(nodes)+1)).difference(fixed))    
    print(fixed)
    print(free)
    return nodes, edges, fixed, free

def format_force_densities(initial_q, settings):
    if settings == "no settings":
        if len(initial_q) == 0:
            force_densities = [float(10) for i in range(len(curves))]
        elif len(initial_q) == 1:
            force_densities = [initial_q[0] for i in range(len(curves))]
        elif len(initial_q) == len(curves):
            force_densities = initial_q
        else:
            force_densities = [float(10) for i in range(len(curves))]
            ghenv.Component.AddRuntimeMessage(e, "Initial q count does not match the number of edges, default force densities are being used")
    else:
        if len(initial_q) == 0:
            force_densities = [settings["lb"]*2 for i in range(len(curves))]
        elif len(initial_q) == 1 and settings["lb"] < min(initial_q):
            force_densities = [initial_q[0] for i in range(len(curves))]
        elif len(initial_q) == 1 and settings["lb"] >= min(initial_q):
            ghenv.Component.AddRuntimeMessage(w, "The provided force density is below the minimum threshold for the optimizer")
            force_densities = [initial_q[0]+settings["lb"] for i in range(len(curves))]
        elif len(initial_q) == len(curves) and settings["lb"] < min(initial_q):
            force_densities = initial_q
        elif len(initial_q) == len(curves) and settings["lb"] >= min(initial_q):
            force_densities = [initial_q[i]+settings["lb"] for i in range(len(curves))] 
        else:
            force_densities = [float(10) for i in range(1, len(curves))]
            ghenv.Component.AddRuntimeMessage(e, "Initial q count does not match the number of edges, default force densities are being used")
    return force_densities

def format_loads(nodes, loads):
    if len(loads) == 0:
        p = [(0,0,0) for i in range(len(nodes))]
    elif len(loads) == 1:
        p = [(loads[0].X,loads[0].Y,loads[0].Z) for i in range(len(nodes))]
    elif len(loads) == len(nodes):
        p = [(loads[i].X, loads[i].Y, loads[i].Z) for i in range(len(nodes))]
    else:
        p = [(0,0,0) for i in range(len(nodes))]
        ghenv.Component.AddRuntimeMessage(e, "Number of loads does not match number of nodes. Default load (0,0,0) has been applied")
    return p

if close is True:
    close = "close"
    network = json.dumps(close)
else:
    
    if settings is None:
        settings = "no settings"
    else:
        settings = json.loads(settings)
    force_densities = format_force_densities(initial_q, settings)
    nodes, edges, fixed, free = format_nodes_edges(curves,curve_IDs)
    loads = format_loads(nodes, loads)    
    network = {"nodes":nodes,"fixed":fixed,"free":free, "edges":edges,"p":loads,"q":force_densities, "settings":settings}
    network = json.dumps(network, indent=4)
    nodes = th.list_to_tree(nodes, None)
    edge_names = th.list_to_tree(edges.keys(), None)
    edge_end_IDs = th.list_to_tree(edges.values(), None)
# ---------- end construct_network ----------

# ----
network_to_json = GhPythonScript(button=Button(), msg=construct_network.network)  # -> out, a
# ---------- network_to_json: Python ----------
__author__ = "Adam"
__version__ = "2022.12.06"

import rhinoscriptsyntax as rs

import json

if button is True:
    with open("C:\\Users\\Adam\\Desktop\\test.json", "w") as outfile:
        outfile.write(msg)
# ---------- end network_to_json ----------
dam = DataDam(DataA=construct_network.network, BufferDelay=2500000, BufferMode=2)

# ---- group: Websocket Server
reset = BooleanToggle(True)
websocket_client_start = WebsocketClientStart(Address="ws://127.0.0.1:2000/", InitalMessage=dam, Reset=reset)
websocket_client_receiver = WebsocketClientReceiver(WebsocketObjects=websocket_client_start, AutoUpdate=Toggle(True))  # -> Message, Status

# ----
trigger = Trigger(Interval=10, TimerInterval=10)  # disabled
rebuild_network = GhPythonScript(msg=websocket_client_receiver.Message)  # -> x, y, z, index, q, loss, simplify(edge_IDs), simplify(edges)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
# ---------- rebuild_network: Python ----------
__author__ = "Adam"
__version__ = "2022.12.02"

import rhinoscriptsyntax as rs
import json
import ghpythonlib.treehelpers as th

if msg:
    msg = json.loads(msg)
    keys = msg.keys()
    print(keys)

    if "node_indices" in keys:
        index = msg["node_indices"]

    if "new_pos" in keys:
        x = msg["new_pos"][0]
        y = msg["new_pos"][1]
        z = msg["new_pos"][2]

    if "q" in keys:
        q = msg["q"]
    
    if "loss" in keys:
        loss = msg["loss"]
    
    if "edges" in keys:
        edges = msg["edges"][0]
        edge_IDs_unsorted = msg["edges"][1].values()[0]
        #print edge_IDs_unsorted
        edge_IDs_sorted = [edge_IDs_unsorted[i] for i in edges]
        edge_IDs = th.list_to_tree(edge_IDs_sorted)        
        
    if "lengths" in keys:
        lengths = msg["lengths"]
        
    if "gradients" in keys:
        gradients = th.list_to_tree(msg["gradients"])
    
    if "xyz_all" in keys:
        xyz_all = th.list_to_tree(msg["xyz_all"])
        
    if "q_all" in keys:
        q_all = th.list_to_tree(msg["q_all"])
        print(q_all)
        
    if "iterations_to_converge" in keys:
        iterations = msg["iterations_to_converge"]
        print(iterations)
        
    if "len_storage" in keys:
        length_all = th.list_to_tree(msg["len_storage"])
# ---------- end rebuild_network ----------
pt = ConstructPoint(XCoordinate=rebuild_network.x, YCoordinate=rebuild_network.y, ZCoordinate=rebuild_network.z)
graph = QuickGraph(rebuild_network.loss, SortOrder=0)

# ---- group: Basic, Force Visualization
sort = SortList(Keys=rebuild_network.index, ValuesA=pt)  # -> Keys, ValuesA
item = ListItem(List=sort.ValuesA, Index=expr("x-1", rebuild_network.edge_IDs), Wrap=True)  # -> simplify(Item)
dispatch = Dispatch(List=item, DispatchPattern=[True, False])  # -> flatten(ListA), flatten(ListB)
Y = UnitY(Factor=Slider(0, range=-10000..0))
ln = Line(StartPoint=dispatch.ListA, EndPoint=dispatch.ListB)  # -> flatten(Line)
len = Length(Curve=ln)
move = Move(Geometry=ln, Motion=Y)  # -> Geometry, Transform
multiplication = Multiplication(A=len, B=rebuild_network.q)
multiplication_2 = Multiplication(A=multiplication, B=len)
bnd = Bounds(Numbers=multiplication)
ma = MassAddition(Input=multiplication_2)  # -> Result, PartialResults
python = GhPythonScript(curves=move.Geometry, radius=Slider(0.1, range=0..10), faces=Slider(4, range=3..10))  # -> pipes; inputs curves: list of Curve, radius: list
# ---------- python: Python ----------
__author__ = "Adam"
__version__ = "2022.12.05"

import rhinoscriptsyntax as rs
import Rhino

pipes = []


for i, curve in enumerate(curves):
    cap = Rhino.Geometry.MeshPipeCapStyle(0)
    if len(radius) == 1:
        pipe = Rhino.Geometry.Mesh.CreateFromCurvePipe(curve = curve, radius = radius[0], segments = faces,accuracy = 0, capType = cap, faceted = False)
    else:
        pipe = Rhino.Geometry.Mesh.CreateFromCurvePipe(curve = curve, radius = radius[i], segments = faces,accuracy = 0, capType = cap, faceted = False)
    pipes.append(pipe)
# ---------- end python ----------
dedomain = DeconstructDomain(Domain=bnd)  # -> Start, End
pt_2 = ConstructPoint(XCoordinate=Slider(695, range=0..1000), YCoordinate=Slider(701, range=0..1000), ZCoordinate=0)
gradient = Gradient(
    LowerLimit=dedomain.Start,
    UpperLimit=dedomain.End,
    Parameter=multiplication,
    stops=[0: RGB(0, 128, 0), 0.5: RGB(255, 255, 0), 1: RGB(255, 0, 0)])
panel_2 = Panel(ma.Result)
swatch = ColourSwatch(SwatchColor=RGB(255, 0, 0))
concat = Concatenate(FragmentA="Σ|F|L = ", FragmentB=ma.Result)
texttoscreen = RenderTextToScreen(Text=concat, Location=pt_2, Size=12, Color=RGB(0, 0, 0), m_scWithvp=False)
preview_2 = CustomPreview(Geometry=flatten(python), Material=gradient)

# ---- group: Update Rhino Geometry to Match Form Found Geometry While Maintining GUIDS
updatecurves = Button()
id = Guid(rebuild_network.edges)
pt2num = PointsToNumbers(Points=graft(pt), Mask=4)  # -> simplify(Numbers)
update_rhino_geometry = GhPythonScript(button=updatecurves, GUIDs=id, edges=rebuild_network.edge_IDs, points=pt2num)  # -> out, a; inputs GUIDs: list, edges: tree, points: tree
# ---------- update_rhino_geometry: Python ----------
__author__ = "Adam"
__version__ = "2022.12.05"

import rhinoscriptsyntax as rs
import scriptcontext as sc
import Rhino 
import ghpythonlib.treehelpers as th

if button is True:
    points = th.tree_to_list(points, None)
    edges = th.tree_to_list(edges, None)
    
    sc.doc = Rhino.RhinoDoc.ActiveDoc

    for i, edge in enumerate(edges):
        ID = GUIDs[i]
        start_pt = points[edge[0]-1]
        end_pt = points[edge[1]-1]
        start_3d = Rhino.Geometry.Point3d(start_pt[0],start_pt[1],start_pt[2])
        end_3d = Rhino.Geometry.Point3d(end_pt[0],end_pt[1],end_pt[2])
        line = Rhino.Geometry.Line(start_3d,end_3d)
        replace = sc.doc.Objects.Replace(ID, line)

    sc.doc.Views.Redraw()
    sc.doc = ghdoc

else:
    a = "waiting"
# ---------- end update_rhino_geometry ----------
